# Grasshopper definition ExampleFile.gh (Grasshopper 1.0.8)
# plug-ins: Natrix

curve = Curve(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)
curve_2 = Curve([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])

# ----
# Input Geometry
# Check the input curve dimensions against Rhino’s model units. Geometry must be drawn at its intended real-world scale.
# 
# Exclusion Boundaries — Optional
# Connect boundaries for areas that should remain excluded from the layout. Leave this input empty to use the entire parking outline.
# 
# Parking Solver
# Choose the entrance side and generation settings, then press Start to generate alternatives. Press Stop before reviewing or exporting results. Cell size is specified in meters and converted to Rhino model units automatically.
# 
# Organize Results
# Collects generated parking options and sorts them by score. Reset defaults to False; set it to True to clear previous results when the next parking arrives, then return it to False.
# 
# Set Evaluation Weights
# Default weights: parking capacity 90%; average path length, average turns, path-length variation, and turn-count variation 2.5% each. Lower variation means more consistent access across parking spaces.
# 
# Understanding Scores
# Scores range from 0 to 1 and compare options within the connected collection. Higher is better. Scores may change as new options are added; they are not absolute quality ratings.
# 
# Export Top Parking Options — PNG + Rhino
# Connect a parking collection and set Top Count to choose how many highest-scoring options to export. The export includes individual PNGs, a combined overview PNG, and a Rhino .3dm file. PNG Width controls individual image resolution: 800–4096 pixels.
# 
# Export CSV + Chart
# On Deconstruct Parking Collection, click “Export CSV + chart” and choose a save location. This saves a ranked results table and a PNG chart for comparing the collection’s options.
# 
# Reading the Chart
# Rank 1 has the highest score. In the parallel-coordinates chart, each line represents one option; better values appear at the top of every axis. Distances use Rhino model units and are estimated from the parking grid.
# 
# Preview and Bake
# Preview displays the selected option without adding objects to Rhino. Bake creates Rhino objects. Car geometry is included internally; no external car block is required.
curve_3 = Curve(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)
curve_4 = Curve(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)

curve_5 = Curve(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)
curve_6 = Curve([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])

crv = Curve(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)
curve_7 = Curve(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)

curve_8 = Curve(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)
curve_9 = Curve([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])

curve_10 = Curve(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)
curve_11 = Curve([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])

curve_12 = Curve(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)
curve_13 = Curve([<curve referenced from the Rhino model> x2])  # disabled

crv_2 = Curve(reparameterize(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))
# Natrix Overview
crv_3 = Curve(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)
crv_4 = Curve(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)
crv_5 = Curve(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)
crv_6 = Curve(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)
crv_7 = Curve(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)
crv_8 = Curve(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)
crv_9 = Curve(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)
parking_solver = ParkingSolver(
    Outline=crv_9,
    AddRamp=False,
    CellSizeMeters=5,
    EntranceSide=0,
    FastCellSizeMeters=5,
    FastDurationSeconds=0,
    GenerationInterval=1000,
    WasRunning=False)
sortresults = SortResults(ResetGeneration=Toggle(False), Parking=parking_solver)  # -> Parking, GenerationCollection
deconstruct_parking_collection = DeconstructParkingCollection(GenerationCollection=sortresults.GenerationCollection)  # -> Ids, Scores
list_item = ListItem(List=deconstruct_parking_collection.Ids, Index=Slider(2, range=0..30), Wrap=True)
selectparking = SelectParking(Generations=sortresults.GenerationCollection, ParkingId=list_item)
boolean_toggle = BooleanToggle(True)
export_top_parking_options = ExportTopParkingOptions(GenerationCollection=sortresults.GenerationCollection, TopCount="9", PNGWidth=2000)  # -> SelectedOptions, Scores
preview_parking_result = PreviewParkingResult(
    Parking=selectparking,
    BakeCars=boolean_toggle,
    BakeGradientCells=boolean_toggle,
    BakePath=boolean_toggle,
    BakeExcludedCells=boolean_toggle,
    BakeEntranceCell=boolean_toggle,
    BakeWalls=boolean_toggle)
bake_parking_result = BakeParkingResult(Parking=selectparking)
